# Grasshopper definition antworld_test.gh (Grasshopper 0.9.65)
# plug-ins: Decodes Python Interpreter, Ants

game_of_life = Panel("""count = 0

# for each cell in the neighborhood:
for i in n_vals:
    # if cell is True:
    if i == 1: 
        count += 1 # count it
        
# if home cell is True:
if h_val == 1:
    # if less than 2 or more than 3 neighbors are True:
    if (count < 2) or (count >3) :
        # this cell will be False in the next generation
        h_val = 0
    # else:
    else:
        # this cell will be True in the next generation
        h_val = 1
# else the home cell is False:
else:
    # if exactly 3 neighbors are True:
    if (count == 3):
        # this cell will be True in the next generation
        h_val = 1
    else:
        # else this cell will be False in the next generation
        h_val = 0

h_val = count""")
creates_a_border = Panel("""if len(n_val>2): h_val = 1
else: h_val = 0""")
number_slider = Slider(3, range=2..30)
number_slider_2 = Slider(3, range=2..30)
func_a = Text(game_of_life)
func_b = Text(creates_a_border)

multiplication = Multiplication(A=number_slider_2, B=number_slider)
range = Range(Domain=multiplication, Steps=multiplication)
random = Random(Range=Domain(0, 1), Number=multiplication, Seed=Slider(0.5, range=0..1))
decodes = DecodesPythonScript()  # -> console, a
# ---------- decodes: Python ----------
a.put([0,0,1,0,1,0,0,1,0])
# ---------- end decodes ----------
round = Round(Number=random)  # -> Nearest, Floor, Ceiling

gridworld = AntsGridWorld(Rows=number_slider_2, NumberOfColumns=number_slider, Value="1.5", ConnectCorners=False)
func_a_2 = Text(func_a)
ants = AntsCompoent(AWorld=gridworld, Script=func_a_2, Generations=Slider(2, range=0..10))
worldtolines = AntsGridToLines(AWorld=gridworld)
func_b_2 = Text(func_b)
ants_2 = AntsCompoent(AWorld=ants, Script=func_b_2, Generations=Slider(6, range=0..10))
panel = Panel(ants)
panel_2 = Panel(ants_2)
aworldselect = AntsWorldSelector(AWorld=ants_2, Generation=Slider(0, range=0..10))
panel_3 = Panel(aworldselect)
